vi "Main.gviweb"   [LabVIEW NXG 2.0.0]
panel controls:
  "Tab": i32
  "example.skyline-data-services.int_control": bool
  "example.skyline-data-services.numeric_slider-control": f64
  "example.skyline-data-services.string_control": string
  "Message to Write": string
  "write-message": bool
  "Hyperlink Control": string
  "Hyperlink Control_2": string
  "password": string
  "username": string
  "connect": bool
  "server url": string
panel indicators:
  "example.skyline-data-services.int_indicator": bool
  "example.skyline-data-services.numeric_gauge-indicator": f64
  "example.skyline-data-services.string_indicator": string
  "Message Read": string
  "Alert Skyline Error": bool
  "Error": error
uses:
  NI::G Core::Error::Clear Error Cluster.gvi
  subvis::Initialize.gvi
  subvis::Read Example Tags.gvi
  subvis::Write Example Tags.gvi
  subvis::Handle Error and Reconnect.gvi
diagram:
  s1 = uninitialised  # shift register
  s2 = uninitialised  # shift register
  s3 = "initialize"  # shift register
  while {
    Wait(time to wait=250)
    case (s3) {
      frame 5, Default {
        call "Clear Error Cluster.gvi"(error in=s1) -> (error out=w4)
        sequence {
          frame 0 {
            $"Alert Skyline Error" <- FALSE
          }
        }
        call "Initialize.gvi"(server url=$"server url", username=$username, password=$password, error in=w4) -> (error out=w2, tags=w3)
        w1 = $Tab
      }
      frame 0 {
        call "Read Example Tags.gvi"(tags in=s2, error in=s1) -> (tags out=w3, example.skyline-data-services.int_indicator=w5, example.skyline-data-services.numeric_gauge-indicator=w6, example.skyline-data-services.string_indicator=w7, error out=w2)
        $"example.skyline-data-services.string_indicator" <- w7
        $"example.skyline-data-services.numeric_gauge-indicator" <- w6
        $"example.skyline-data-services.int_indicator" <- w5
        w1 = $Tab
      }
      frame 1 {
        call "Write Example Tags.gvi"(tags in=s2, example.skyline-data-services.int_control=$"example.skyline-data-services.int_control", example.skyline-data-services.numeric_slider-control=$"example.skyline-data-services.numeric_slider-control", example.skyline-data-services.string_control=$"example.skyline-data-services.string_control", error in=s1) -> (tags out=w3, errror out=w2)
        w1 = $Tab
      }
      frame 2 {
        w1 = $Tab
        w2 = s1
        w3 = s2
      }
      frame 3 {
        w1 = s3
        w2 = s1
        w3 = s2
      }
      frame 4 {
        Property Node(instance in=s1) -> ("status"=w8)
        $"Alert Skyline Error" <- w8
        w1 = s3
        w2 = s1
        w3 = s2
      }
    }
    call "Handle Error and Reconnect.gvi"(state in=w1, connect=$connect, Error_2=w2) -> (state out=w9, Error_3=w10)
    $Error <- w2
    next s1 = w10
    next s2 = w3
    next s3 = w9
    stop if FALSE
  }
